% Simulink data dictionary pulsesgenDictionary.sldd

REPEATS_PRD = Simulink.Parameter(0.1, Unit="sec")  % Period between pulses in automatic pressing mode
PAUSE_PRD = Simulink.Parameter(1, Unit="sec")  % Period of trasition from manual pressing mode to automatic pressing mode