% Simulink data dictionary pwmgenDictionary.sldd

TYPE = enum(DefaultValue="FRONT", StorageType="uint8")  % Типы ШИС-сигналов:
  % FRONT - Передний фронтальный
  % BACK - Задний фронтальный
  % CENTERED - Центрированный
  FRONT = 1
  BACK = 2
  CENTERED = 3

PWM_FREQ = Simulink.Parameter(50000, Unit="Hz")  % Частота ШИМ-сигналов