% Simulink data dictionary pwmgenDictionary.sldd

PWM_FREQ = Simulink.Parameter(10000, Unit="Hz")  % Частота ШИМ-сигналов

TYPE = enum(DefaultValue="FRONT", StorageType="uint8")  % Типы ШИС-сигналов:
  % FRONT - Передний фронтальный
  % BACK - Задний фронтальный
  % CENTERED - Центрированный
  FRONT = 1
  BACK = 2
  CENTERED = 3