# Requirement set pwmProjectReqs (R2022a)

## 1 [buttons] Нажимные кнопки (Container)

### 1.1 [buttons_1] Количество кнопок
В проекте должно быть задействовано 5 нажимных кнопок

### 1.2 [buttons_2] Расположение кнопок на панели (Informational)
Нажимные кнопки должны располагаться на панели в следующем порядке:
N
W C E
S

### 1.3 [buttons_3] Функции кнопок (Container)

#### 1.3.1 [buttons_3_1] Функция кнопки N
По нажатию кнопки N коэффициент заполнения ШИМ должен увеличиваться

#### 1.3.2 [buttons_3_2] Функция кнопки S
По нажатию кнопки S коэффициент заполнения ШИМ должен уменьшаться

#### 1.3.3 [buttons_3_3] Функция кнопки C
По нажатию кнопки С коэффициент заполнения ШИМ должен стать равным нулю

#### 1.3.4 [buttons_3_4] Функция кнопки W
По нажатию кнопки W должен происходить переход к следующему каналу ШИМ

#### 1.3.5 [buttons_3_5] Функция кнопки E
По нажатию кнопки Е должен происходить переход к предыдущему каналу ШИМ

### 1.4 [buttons_4] Одновременное нажатие нескольких кнопок
При одновременном нажатии нескольких кнопок программа не должна менять внутренние значения

## 2 [filter] Блок фильтрации входных сигналов (Container)
Описание работы блока
Блок обеспечивает устранение дребезга при нажатии и отпускании кнопки. Необходимо иметь возможность задания времени переходного процесса в механических контактах.

### 2.1 [filter_1] Период фильтрации
Модуль должен фильтровать дребезг при нажатии и отпускании кнопок, который длится не более 10 мс

## 3 [state_machine] Блок обработки сигналов с нажимных кнопок
Описание работы блока
Однократное непродолжительное нажатие на кнопку N (S) приводит соответственно к увеличению (уменьшению) текущего значения коэффициента заполнения на единицу. При удержании кнопки N (S) в нажатом состоянии по истечении некоторого времени происходит автоматическое увеличение или уменьшение текущего значения с установленной частотой обновления данных

### 3.1 [state_machine_1] Длительность паузы
Пауза при переходе между режимами однократного нажатия и автоматического изменения значения коэффициента заполнения должна быть 0.5 секунды

### 3.2 [state_machine_2] Период обновления данных
В режиме автоматического изменения значения коэффициента заполнения он должен увеличиваться (уменьшаться) с периодом 0.25 секунды

## 4 [pwm] Блок формирования ШИМ-сигнала

### 4.1 [pwm_1] Разрядность ШИМ-сигнала
Предусмотреть изменение разрядности ШИМ-сигнала от 5 до 10 разрядов. Значение по умолчанию 8.

### 4.2 [pwm_2] Количество каналов
В проекте должны формироваться три независимых ШИМ-сигнала

### 4.3 [pwm_3] Типы ШИМ-сигналов (Container)

#### 4.3.1 [pwm_3_1] Тип первого ШИМ-сигнала
Тип первого ШИМ-сигнала - фронтальный передний

#### 4.3.2 [pwm_3_2] Тип второго ШИМ-сигнала
Тип второго ШИМ-сигнала - фронтальный задний

#### 4.3.3 [pwm_3_3] Тип третьего ШИМ-сигнала
Тип третьего ШИМ-сигнала - центрированный

### 4.4 [pwm_4] Синхронизирующий сигнал
Блок должен формировать и передавать на выход синхронизирующий сигнал

## 5 [pwm_5] Частота ШИМ-сигналов
Предусмотреть изменения частоты ШИМ-сигналов. Значение по умолчанию 1 кГц