test file "projectTests"

suite "Buttons digital filter"

  case "Pressing and releasing the button with 1ms glitches" [baseline]
    model button_filter, harness button_filter_harness, mode Normal
    test sequence scenario: Scenario_1 (button_filter_harness/Test Sequence)
    assessment "Pressing Event Assessment": At any point of time, whenever enable_as == true & dir == false is true then, with no delay, filt_button == false must be true
    assessment "Releasing Event Assessment": At any point of time, whenever enable_as == true & dir == true is true then, with no delay, filt_button == true must be true
      filt_button: signal button_filter_harness/DUT, port 1
      enable_as: signal button_filter_harness/Assertion Subsystem/Chart, port 1
      dir: signal button_filter_harness/Assertion Subsystem/Chart, port 2

suite "Rollover Handler"

  case "Only one button is pressed" [simulation]
    model rollover_handler, harness rollover_handler_harness
    test sequence scenario: Scenario_1 (rollover_handler_harness/Test Sequence)
    assessment "UP Button Assessment": At any point of time, whenever i_UP == true is true then, with no delay, o_UP == true must be true
    assessment "DOWN Button Assessment": At any point of time, whenever i_DOWN == true is true then, with no delay, o_DOWN == true must be true
    assessment "RESET Button Assessment": At any point of time, whenever i_RESET == true is true then, with no delay, o_RESET == true must be true
    assessment "NEXT Button Assessment": At any point of time, whenever i_NEXT == true is true then, with no delay, o_NEXT == true must be true
    assessment "PREVIOUS Button Assessment": At any point of time, whenever i_PREVIOUS == true is true then, with no delay, o_PREVIOUS == true must be true
      i_UP: signal rollover_handler_harness/Test Sequence, port 1
      i_DOWN: signal rollover_handler_harness/Test Sequence, port 2
      i_RESET: signal rollover_handler_harness/Test Sequence, port 3
      i_NEXT: signal rollover_handler_harness/Test Sequence, port 4
      i_PREVIOUS: signal rollover_handler_harness/Test Sequence, port 5
      o_UP: signal rollover_handler_harness/DUT, port 1
      o_DOWN: signal rollover_handler_harness/DUT, port 2
      o_RESET: signal rollover_handler_harness/DUT, port 3
      o_NEXT: signal rollover_handler_harness/DUT, port 4
      o_PREVIOUS: signal rollover_handler_harness/DUT, port 5

  case "Several buttons are pressed" [simulation]
    model rollover_handler, harness rollover_handler_harness
    test sequence scenario: Scenario_2 (rollover_handler_harness/Test Sequence)
    assessment "Several Buttons Assessment": At any point of time, whenever i_UP == true | i_DOWN == true | i_RESET == true | i_NEXT == true | i_PREVIOUS == true is true then, with no delay, o_UP == false & o_DOWN == false & o_RESET == false & o_NEXT == false & o_PREVIOUS == false must be true
      i_UP: signal rollover_handler_harness/Test Sequence, port 1
      i_DOWN: signal rollover_handler_harness/Test Sequence, port 2
      i_RESET: signal rollover_handler_harness/Test Sequence, port 3
      i_NEXT: signal rollover_handler_harness/Test Sequence, port 4
      i_PREVIOUS: signal rollover_handler_harness/Test Sequence, port 5
      o_UP: signal rollover_handler_harness/DUT, port 1
      o_DOWN: signal rollover_handler_harness/DUT, port 2
      o_RESET: signal rollover_handler_harness/DUT, port 3
      o_NEXT: signal rollover_handler_harness/DUT, port 4
      o_PREVIOUS: signal rollover_handler_harness/DUT, port 5

suite "Pressing Mode Handler"

  case "Continuous pressing of UP button" [simulation]
    model control_pulses_generator, harness control_pulses_generator_harness, stop time 1.55
    signal scenario: Continuous pressing the UP button (control_pulses_generator_harness/Signal Builder)

  case "Continuous pressing of DOWN button" [simulation]
    model control_pulses_generator, harness control_pulses_generator_harness, stop time 1.55
    signal scenario: Continuous pressing the DOWN button (control_pulses_generator_harness/Signal Builder)

  case "Pressing and releasing the UP button" [simulation]
    model control_pulses_generator, harness control_pulses_generator_harness, stop time 4
    signal scenario: Pressing and releasing the UP button (control_pulses_generator_harness/Signal Builder)

  case "Pressing and releasing the DOWN button" [simulation]
    model control_pulses_generator, harness control_pulses_generator_harness, stop time 4
    signal scenario: Pressing and releasing the DOWN button (control_pulses_generator_harness/Signal Builder)

  case "Short pressing the UP button" [simulation]
    model control_pulses_generator, harness control_pulses_generator_harness, stop time 1.55
    signal scenario: Short pressing the UP button (control_pulses_generator_harness/Signal Builder)

  case "Short pressing the DOWN button" [simulation]
    model control_pulses_generator, harness control_pulses_generator_harness, stop time 4
    signal scenario: Short pressing the DOWN button (control_pulses_generator_harness/Signal Builder)

suite "Data Generator"

  case "Counting from 0 to 31 bits and backward (the first channel)" [simulation]
    model data_counter, harness data_counter_harness, stop time 0.08
    pre-load callback:
      ASI_UD  = Simulink.Parameter(1);
      ASI_RNP = Simulink.Parameter(1);

  case "Counting from 0 to 31 bits and backward with reset (forward direction, the first channel)" [simulation]
    model data_counter, harness data_counter_harness, stop time 0.08
    pre-load callback:
      ASI_UD  = Simulink.Parameter(1);
      ASI_RNP = Simulink.Parameter(2);

  case "Counting from 0 to 31 bits and backward with reset (inverse direction, the first channel)" [simulation]
    model data_counter, harness data_counter_harness, stop time 0.08
    pre-load callback:
      ASI_UD  = Simulink.Parameter(1);
      ASI_RNP = Simulink.Parameter(4);

  case "Counting from 0 to 31 bits and backward with channel switching" [simulation]
    model data_counter, harness data_counter_harness, stop time 0.11
    pre-load callback:
      ASI_UD  = Simulink.Parameter(2);
      ASI_RNP = Simulink.Parameter(5);

  case "Counting from 0 to 31 bits and backward with channel switching and reset" [simulation]
    model data_counter, harness data_counter_harness, stop time 0.11
    pre-load callback:
      ASI_UD  = Simulink.Parameter(2);
      ASI_RNP = Simulink.Parameter(3);

  case "Counting from 0 to 31 bits and backward with full channel switching cycle" [simulation]
    model data_counter, harness data_counter_harness, stop time 0.23
    pre-load callback:
      ASI_UD  = Simulink.Parameter(3);
      ASI_RNP = Simulink.Parameter(6);

suite "PWM Generator"

  case "Check changing of duty cycles from 0 to 1" [simulation]
    model pwm_generator, harness pwm_generator_harness, stop time 0.006
    post-load callback:
      calculatePrescalers;
      counterType = 'UP';
      createTestSignalsForPWM;

  case "Check changing of duty cycles from 0 to 1 and reverse" [simulation]
    model pwm_generator, harness pwm_generator_harness, stop time 0.0105
    post-load callback:
      calculatePrescalers;
      counterType = 'REVERSE';
      createTestSignalsForPWM;